# Dynamo graph Sandbox - Launch Revit and open project file.dyn (Dynamo 0.8.1.1473)

revit_version = StringInput("2015")
byVersion = Custom[RevitExecutablePath.ByVersion](RevitVersion=revit_version)  # Returns the path of Revit.exe based on a given Revit version
file_path_revit_file = Filename("C:\Program Files\Autodesk\Revit 2015\Samples\rac_basic_sample_project.rvt")
code_block = CodeBlock(revit_file=file_path_revit_file) { "\"" + revit_file + "\""; }
# note: Will open a project file alright, but afterwards the Dynamo addin cannot be launched manually.
# "Revit could not complete the external command. ..."
run = Custom[ExternalApplication.Run](Executable_Path=byVersion, Arguments=code_block)  # Launches a given external application with the given arguments
