# Dynamo graph Sandbox - Launch Revit with Dynamo.dyn (Dynamo 0.8.1.1473)

revit_version = StringInput("2015")
byVersion = Custom[RevitExecutablePath.ByVersion](RevitVersion=revit_version)  # Returns the path of Revit.exe based on a given Revit version
file_path_revit_file = Filename("C:\Program Files\Autodesk\Revit 2015\Samples\rac_basic_sample_project.rvt")
run = Custom[ExternalApplication.Run](Executable_Path=byVersion, Arguments=file_path_revit_file)  # Launches a given external application with the given arguments
