# Dynamo custom node Journal.RevitStartupArguments.dyf (Dynamo 1.3.0.875)
# category: DynamoAutomation.Journal.Create
# Creates startup arguments for Revit

disableSplashScreen = Input(disableSplashScreen : bool = true)
string = StringInput("/nosplash ")
string_2 = StringInput("")
if_ = If(test=disableSplashScreen, true=string, false=string_2)
journalPath = Input(journalPath : string)
code_block = CodeBlock(nosplash=if_, jpath=journalPath) { " /language ENU " + nosplash + jpath; }
args = Output(code_block)
