# Dynamo custom node JournalFile.ExtractCommands.dyf (Dynamo 1.0.0.1180)
# category: DynamoAutomation.Journal.Query
# Extracts all commands and directives from a Revit journal file.

string = StringInput("\n")
file = Input(file : System.IO.FileInfo)
readText = File.ReadText(file)
split = String.Split(readText, string)
trimLeadingWhitespace = String.TrimLeadingWhitespace(split)
string_2 = StringInput("'")
startsWith = String.StartsWith(str=trimLeadingWhitespace, searchFor=string_2)
filterByBoolMask = List.FilterByBoolMask(list=trimLeadingWhitespace, mask=startsWith)
join = String.Join(string, filterByBoolMask.out)
firstItem = List.FirstItem(join)
string_3 = StringInput("""_
,""")
string_4 = StringInput(",")
replace = String.Replace(str=firstItem, searchFor=string_3, replaceWith=string_4)
string_5 = StringInput("\"  ,")
string_6 = StringInput("\" ,")
replace_2 = String.Replace(str=replace, searchFor=string_5, replaceWith=string_6)
str = Output(replace_2)
