# Dynamo custom node JournalFiles.Cleanup.dyf (Dynamo 1.3.1.1736)
# category: DynamoAutomation.Journal.Actions
# Moves all journal files created during a batch-processing operation to a specified directory

generatedJournalFiles = Input(generatedJournalFiles : string[])
directoryName = FilePath.DirectoryName(generatedJournalFiles)
firstItem = List.FirstItem(directoryName)
fromPath = DirectoryObject(firstItem)  # "Directory.FromPath"
contents = Directory.Contents(fromPath)
string = StringInput("journal.[0-9]+.txt")
containsRegularExpression = Custom[Regex.ContainsRegularExpression](RegEx=string, str=contents)  # "String.ContainsRegularExpression"; Determines if a regular expression matches a string (or a list of strings), i.e. occurs anywhere in the string, and returns a boolean value (or a list, depending on the input). The syntax for regular expressions is explained at http://ironpython-test.readthedocs.org/en/latest/howto/regex.html
filterByBoolMask = List.FilterByBoolMask(list=contents, mask=containsRegularExpression)
string_2 = StringInput("dump.[0-9]+.txt")
containsRegularExpression_2 = Custom[Regex.ContainsRegularExpression](RegEx=string_2, str=contents)  # "String.ContainsRegularExpression"
filterByBoolMask_2 = List.FilterByBoolMask(list=contents, mask=containsRegularExpression_2)
string_3 = StringInput("journal.[0-9]+.[0-9]+.dmp")
containsRegularExpression_3 = Custom[Regex.ContainsRegularExpression](RegEx=string_3, str=contents)  # "String.ContainsRegularExpression"
filterByBoolMask_3 = List.FilterByBoolMask(list=contents, mask=containsRegularExpression_3)
join = List.Join(generatedJournalFiles, filterByBoolMask.in, filterByBoolMask_2.in, filterByBoolMask_3.in)
uniqueItems = List.UniqueItems(join)
executionDone = Input()
code_block = CodeBlock(passthrough=uniqueItems, waitfor=executionDone) { {passthrough,waitfor}[0]; }
destinationDirectory = Input(destinationDirectory : string)
replace = String.Replace(str=uniqueItems, searchFor=firstItem, replaceWith=destinationDirectory)
overwriteExistingFiles = Input(overwriteExistingFiles : bool = true)
move = File.Move(code_block, replace, overwriteExistingFiles)
Output = Output(move)  # ""
