# Dynamo custom node RevitAddinsPath.ByVersion.dyf (Dynamo 0.8.3.2580)
# category: DynamoAutomation.FilePath.Create
# Returns the path of Revit Addins folder based on a given Revit version

RevitVersion = Input(RevitVersion : string = "2016")
code_block = CodeBlock(RevitVersion=RevitVersion) { "C:\ProgramData\Autodesk\Revit\Addins\\" + RevitVersion; }
Revit_Addins_Directory_Path = Output(code_block)
