# Dynamo custom node RevitExecutablePath.ByVersion.dyf (Dynamo 1.3.1.1736)
# category: DynamoAutomation.FilePath.Create
# Returns the path of Revit.exe based on a given Revit version

string = StringInput("C:\Program Files\Autodesk\Revit ")
revitVersion = Input(revitVersion : string = "2018")
string_2 = StringInput("\Revit.exe")
code_block = CodeBlock(basepath=string, RevitVersion=revitVersion, executable=string_2) { basepath + RevitVersion + executable; }
revitExecutablePath = Output(code_block)
