# Dynamo graph CountWalls_R2017.dyn (Dynamo 1.3.0.875)

# group: INPUTS
# note: Example for a slave graph that retrieves information from a model and adds it to an existing CSV file.
directory_path_csv_file = Directory("C:\temp\DynamoAutomation\output")
filename_csv_file = StringInput("AutomatedReport")
categories = Categories("Walls")
script_name = StringInput("CountWalls_R2017.dyn")

# group: Collect data from CSV file
string = StringInput("\")
code_block = CodeBlock(dir=directory_path_csv_file, delimiter=string, filename=filename_csv_file) { dir + delimiter + filename + ".CSV"; }
fromPath = FileObject(code_block)  # "File.FromPath"
readFromFile = CSV.ReadFromFile(fromPath)

# group: Collect data from model
current = Document.Current()
filePath = Document.FilePath(current)
all_elements_of_category = ElementsOfCategory(categories)
count = List.Count(all_elements_of_category)
now = DateTime.Now()
code_block_2 = CodeBlock(path=filePath, count=count, scriptname=script_name, now=now) { {{path,count,scriptname,now}}; }

# group: Append collected data to CSV file
join = List.Join(readFromFile, code_block_2)
writeToFile = CSV.WriteToFile(code_block, join)

killCurrentProcess = ProcessRunner.Process.KillCurrentProcess(writeToFile)
