# Dynamo graph A2 - Sandbox.dyn (Dynamo 0.8.1.1473)

# group: INPUTS
file_path_directory_paths_text = Filename("C:\Users\adieckmann\Documents\GitHub\DynamoAutomation\scenarios\A2\Directory Paths.txt")  # "File Path (Directory Paths Text File)"
file_path_dynamo_file = Filename("C:\Users\adieckmann\Desktop\FamParam.dyn")
directory_path_journal_file = Directory("C:\Users\adieckmann\Desktop")
revit_version = StringInput("2015")

# group: Create list of Revit files
fromPath = FileObject(file_path_directory_paths_text)  # "File.FromPath"
readText = File.ReadText(fromPath)
string = StringInput("\n")
split = String.Split(readText, string)
fromPath_2 = DirectoryObject(split)  # "Directory.FromPath"
code_block = CodeBlock { "*.rvt"; }
contents = Directory.Contents(fromPath_2, code_block)
flatten = Flatten(contents)

# group: Create journal files
count = List.Count(flatten)
code_block_2 = CodeBlock(n=count) { suffix = 1..n; "DynamoJournalFile_" + suffix; }
byPaths2 = Custom[RevitJournalFile.ByPaths2](RevitFile=flatten, DynamoFile=file_path_dynamo_file, JournalDirectory=directory_path_journal_file, JournalFileName=code_block_2.out1)  # Creates a Revit journal file that starts Revit with a given project/family and launches the Dynamo addin with a given Dynamo graph.

# group: Batch-process Revit files
byVersion = Custom[RevitExecutablePath.ByVersion](RevitVersion=revit_version)  # Returns the path of Revit.exe based on a given Revit version
run = Custom[ExternalApplication.Run](ExecutablePath=byVersion)  # Launches a given external application with the given arguments
map = List.Map(list=byPaths2, f_x=run)
