# Dynamo graph A4 - Sandbox.dyn (Dynamo 0.8.1.1473)

# group: INPUTS
file_path_file_paths_text_file = Filename("C:\Users\adieckmann\Documents\GitHub\DynamoAutomation\scenarios\A4\File Paths.txt")
file_path_dynamo_file_1 = Filename("C:\Users\adieckmann\Desktop\FamParam.dyn")
file_path_dynamo_file_2 = Filename("C:\Users\adieckmann\Desktop\Home.dyn")
directory_path_journal_file = Directory("C:\Users\adieckmann\Desktop")
revit_version = StringInput("2015")

# group: Create list of Revit files
fromPath = FileObject(file_path_file_paths_text_file)  # "File.FromPath"
readFromFile = CSV.ReadFromFile(fromPath)
transpose = List.Transpose(readFromFile)
code_block = CodeBlock(seq=transpose) { seq[0]; seq[1]; seq[2]; }
exists = File.Exists(code_block.out0)
code_block_2 = CodeBlock(x=code_block.out1, fe=exists, y=code_block.out2) { x == 1 && fe; y == 1 && fe; }
filterByBoolMask = List.FilterByBoolMask(list=code_block.out0, mask=code_block_2.out0)
filterByBoolMask_2 = List.FilterByBoolMask(list=code_block.out0, mask=code_block_2.out1)
join = List.Join(filterByBoolMask.in, filterByBoolMask_2.in)

# group: Create journal files
count = List.Count(filterByBoolMask.in)
ofRepeatedItem = List.OfRepeatedItem(item=file_path_dynamo_file_1, amount=count)
count_2 = List.Count(filterByBoolMask_2.in)
ofRepeatedItem_2 = List.OfRepeatedItem(item=file_path_dynamo_file_2, amount=count_2)
join_2 = List.Join(ofRepeatedItem, ofRepeatedItem_2)
code_block_3 = CodeBlock(a=count, b=count_2) { suffix = 1..(a+b); "DynamoJournalFile_" + suffix; }
byPaths2 = Custom[RevitJournalFile.ByPaths2](RevitFile=join, DynamoFile=join_2, JournalDirectory=directory_path_journal_file, JournalFileName=code_block_3.out1)  # Creates a Revit journal file that starts Revit with a given project/family and launches the Dynamo addin with a given Dynamo graph.

# group: Batch-process Revit models
byVersion = Custom[RevitExecutablePath.ByVersion](RevitVersion=revit_version)  # Returns the path of Revit.exe based on a given Revit version
run = Custom[ExternalApplication.Run](ExecutablePath=byVersion)  # Launches a given external application with the given arguments
map = List.Map(list=byPaths2, f_x=run)
